# Grasshopper definition sample.gh (Grasshopper 1.0.7)
# plug-ins: pythonhopper Info

panel = Panel("""def func(a, b):
    return a + b

result = func(2.0, 1.0)""")
panel_2 = Panel("result = 1.0+1.0")
nickname = PythonhopperComponent(PythonCode=panel)
panel_3 = Panel(nickname)
